# Grasshopper definition Natural_Ventilation_UI.gh (Grasshopper 0.9.76)
# plug-ins: CORE.GH, Python Interpreter, Human UI, ItemSelector

filepicker = CreateFilePicker(ButtonLabelText="Browse ext conc file...", DialogType=0, MustExist=True, Filter="Text files|*.txt")
values = ValueListener(Elements=filepicker, SomeProperty=True)  # -> Values, Indices
panel = Panel(values.Values)
file = ReadFile(File=panel, PerLineParse=True)
list = ValueList({"South": 0, "East": 1, "North": 2, "West": 3}, selected="West")
# Geometry
bldgprograms = Honeybee_bldgPrograms({"Office": 0, "Retail": 1, "MidriseApartment": 2, "PrimarySchool": 3, "SecondarySchool": 4, "SmallHotel": 5, "LargeHotel": 6, "Hospital": 7, "Outpatient": 8, "Warehouse": 9, "SuperMarket": 10, "FullServiceRestaurant": 11, "QuickServiceRestaurant": 12}, selected="Office")
panel_2 = Panel("""Jan
Feb
Mar
Apr
May
Jun
Jul
Aug
Sep
Oct
Nov
Dec""")
débit_spécifique = Slider(30, range=0..100)
nb_of_occupants = Slider(2, range=0..10)
exterior_concentration_of_pollutant = Panel(file)
interior_max_concentration = Panel("1500")
pulldown = CreatePulldownMenu(Label="orientation hosting window", ListItems=list, showLabel=True)
values_2 = ValueListener(Elements=pulldown, SomeProperty=True)  # -> Values, Indices
pulldown_2 = CreatePulldownMenu(Label="main use", ListItems=bldgprograms, showLabel=True)
panel_3 = Panel("""Month
Conc (ppm)""")
entwine = Entwine(Branch00=panel_2, Branch01=exterior_concentration_of_pollutant, FlattenInputs=True)  # -> simplify(Result)
# Set Up The Geometry
honeybee = Honeybee_Honeybee()  # -> Vviiiiiiiiiizzz; plug-in component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
values_3 = ValueListener(Elements=pulldown_2, SomeProperty=True)  # -> Values, Indices
ladybug = Ladybug_Ladybug()  # -> Vviiiiiiiiiizzz; plug-in component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
datatable = CreateDataTable(Data=entwine, ColumnHeadings=panel_3, AllowSorting=False, ColumnSizingMode=-1)
textbox = CreateTextBox(Label="specific pollutant flow (gr/h pers)", DefaultText=débit_spécifique, UpdateButton=True, showLabel=True)
slider = CreateSlider(Slider=nb_of_occupants, ShowBounds=True, showLabel=True, ShowTicks=True, ShowTooltip=True, ShowValLabel=True)
box = CenterBox(Base=PlaneXY(0, 0, 0), X=1, Y=1, Z=1)
values_4 = ValueListener(Elements=textbox, SomeProperty=True)  # -> Values, Indices
values_5 = ValueListener(Elements=slider, SomeProperty=True)  # -> Values, Indices
launchwin = LaunchWindow(Show=Toggle(True), Name="Conditions", Width=370, Height=700, ChildStatus=0, EnableHorizScroll=False)
launchwin_2 = LaunchWindow(Show=Toggle(True), Name="Room geometry", Width=370, Height=700, ChildStatus=0, EnableHorizScroll=False)
textbox_2 = CreateTextBox(Label="interior max concentration (ppm)", DefaultText=interior_max_concentration, UpdateButton=True, showLabel=True)
series = Series(Start=0, Step=1, Count=6)
cset = CreateSet(List=series)  # -> Set, Map
values_6 = ValueListener(Elements=textbox_2, SomeProperty=True)  # -> Values, Indices
num = Number(values_2.Indices)
_3dview = Create3DView(MeshToDisplay=box, MeshColors=RGB(255, 0, 0), ViewWidth=300, ViewHeight=300)
exdiff = SetDifferenceS(SetA=cset.Set, SetB=num)
# Apply Properties for an Energy Simulation
panel_4 = Panel("Zone1")
listzoneprograms = Honeybee_ListZonePrograms(bldgProgram=values_3.Indices)  # -> OfficeZonePrograms; plug-in component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
col = Colour([RGB(255, 255, 192), RGB(255, 255, 192), RGB(255, 255, 192), RGB(255, 255, 192), RGB(255, 255, 192), RGB(0, 255, 255)])
list_2 = Honeybee_ItemSelector(
    listzoneprograms,
    {"Office::BreakRoom", "Office::Storage", "Office::Vending", "Office::OpenOffice", "Office::ClosedOffice", "Office::Conference", "Office::PrintRoom", "Office::Restroom", "Office::Elec/MechRoom", "Office::IT_Room", "Office::Stair", "Office::Corridor", "Office::Lobby"}, selected="Office::OpenOffice")
panel_5 = Panel(" ")
multiplication = Multiplication(A=exterior_concentration_of_pollutant, B=0.001)  # -> simplify(graft(Result))
multiplication_2 = Multiplication(A=values_6.Values, B=0.001)
multiplication_3 = Multiplication(A=values_4.Values, B=values_5.Values)
dup = DuplicateData(Data=multiplication_3, Number=Slider(8760, range=0..10000), Order=True)
open_weather_file = Ladybug_OpenEPWWeatherFile()  # -> epwFile; plug-in component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
# Run the Energy Simulation
number_slider = Slider(3, range=0..10)
true_button = CreateTrueOnlyButton(ButtonName="Run", ButtonStyle=0)
values_7 = ValueListener(Elements=true_button, SomeProperty=True)  # -> Values, Indices
launchwin_3 = LaunchWindow(Show=Toggle(True), Name="Results", Width=500, Height=700, ChildStatus=0, EnableHorizScroll=False)
captureview = Ladybug_CaptureView(fileName="Carpetplot", viewNames="Dessus", transparBack=True, capture=Toggle(True))  # -> imagePath; plug-in component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
image = CreateImage(ImageSource=captureview, ImageWidth=500)
panel_7 = Panel("""Jan
Feb
Mar
Apr
May
Jun
Jul
Aug
Sep
Oct
Nov
Dec""")
legendpar = Ladybug_LegendParameters(highBound=Slider(5, range=0..10))  # -> legendPar; plug-in component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

height_m = Slider(3, range=0..10)
glazing_ratio = Slider(0.05, range=0..1)
east_west_side_m = Slider(6, range=0..10)
north_south_side_m = Slider(4, range=0..10)

textbox_3 = CreateTextBox(Label="glazing ratio (0-1)", DefaultText=glazing_ratio, UpdateButton=True, showLabel=True)
slider_2 = CreateSlider(
    Slider=[north_south_side_m, east_west_side_m, height_m],
    ShowBounds=True,
    showLabel=True,
    ShowTicks=True,
    ShowTooltip=True,
    ShowValLabel=True)
values_8 = ValueListener(Elements=textbox_3, SomeProperty=True)  # -> Values, Indices
values_9 = ValueListener(Elements=slider_2, SomeProperty=True)  # -> Values, Indices
bang = ExplodeTree(Data=values_9.Values)  # -> Branch0, Branch1, Branch2, Branch3
merge = Merge(Data1=pulldown_2, Data2=pulldown, Data3=slider_2, Data4=textbox_3, Data5=_3dview)
addelems = AddElements(Window=launchwin_2, Elements=flatten(merge), DoVLChecking=True)  # -> AddedElements, ElementNames

division = Division(A=bang.Branch2, B=2)
division_2 = Division(A=bang.Branch0, B=2)
division_3 = Division(A=bang.Branch1, B=2)
box_2 = CenterBox(Base=PlaneXY(0, 0, 0), X=division_2, Y=division_3, Z=division)
debrep = DeconstructBrep(Brep=box_2)  # -> Faces, Edges, Vertices
createhbsrfs = Honeybee_createHBSrfs(geometry=debrep.Faces, srfName="Office")  # -> readMe, simplify(flatten(HBSurface)); plug-in component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

item = ListItem(List=createhbsrfs.HBSurface, Index=exdiff, Wrap=True)
item_2 = ListItem(List=createhbsrfs.HBSurface, Index=num, Wrap=True)

glazingcreator = Honeybee_GlazingBasedOnRatio(HBObjects=item_2, glzRatio=values_8.Values, breakUpWindow=Toggle(False), runIt=Toggle(True))  # -> readMe, HBObjWGLZ; plug-in component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
zone1 = Brep([item, glazingcreator.HBObjWGLZ])

debrep_2 = DeconstructBrep(Brep=glazingcreator.HBObjWGLZ)  # -> Faces, Edges, Vertices
createhbzones = Honeybee_createHBZones(name=panel_4, zoneProgram=list_2, HBSurfaces=flatten(zone1), isConditioned=Toggle(False))  # -> readMe, HBZone; plug-in component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
item_3 = ListItem(List=debrep_2.Faces, Index=0, Wrap=True)
set3dview = Set3DView(_3DView=_3dview, MeshToDisplay=flatten([item_3, item]), MeshColors=col)
solveadjc = Honeybee_SolveAdjacencies(HBZones=flatten(createhbzones.HBZone), altConstruction="Air Wall", removeCurrentAdjc=False, findAdjc=Toggle(True))  # -> readMe, HBZonesWADJ; plug-in component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

decomposebytype = Honeybee_DecomposeBasedOnType(HBZone=solveadjc.HBZonesWADJ)  # -> walls, interiorWalls, airWalls, windows, interiorWindows, skylights, roofs, ceilings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; plug-in component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
preview = CustomPreview(Geometry=decomposebytype.windows, Shader=ColourSwatch(SwatchColor=RGBA(87, 238, 255, 121)))

gethbzoneepschedules = Honeybee_GetZoneEnergyPlusSchedules(HBZone=createhbzones.HBZone)  # -> occupancySchedule, occupancyActivitySch, heatingSetPtSchedule, coolingSetPtSchedule, lightingSchedule, equipmentSchedule, infiltrationSchedule; plug-in component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
decomposeepsch = Honeybee_DecomposeEnergyPlusSchedule(schName=gethbzoneepschedules.occupancySchedule)  # -> name, schedule, comments; plug-in component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
convertepschvalues = Honeybee_ConvertEnergyPlusScheduleToValues(schName=gethbzoneepschedules.occupancySchedule)  # -> values, holidays; plug-in component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
split = SplitList(List=convertepschvalues.values, Index=Slider(7, range=0..10))  # -> ListA, ListB
_3dchart = Ladybug_3DChart(inputData=flatten(convertepschvalues.values), xScale="0.25")  # -> readMe, graphMesh, graphCurves, legend, legendBasePts, title, titleBasePts, dataPts, conditionalHOY; plug-in component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
multiplication_4 = Multiplication(A=dup, B=split.ListB)
branchdatadailymonthlyhourly = Ladybug_BranchData(data=multiplication_4)  # -> dataEachDayOfYear, dataEachMonth, dataEachHourOfDay; plug-in component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
expression = Expression(
    Dpoll=branchdatadailymonthlyhourly.dataEachMonth,
    Cext=multiplication,
    Ctol=multiplication_2,
    Expression="Dpoll/(Ctol-Cext)")

# ----
# 1) AutoCalulated Window-Based Natural Ventilation
panel_8 = Panel("0")
zoneattributelist = Honeybee_ZoneAttributeList({"Name": "name", "Zone Program": "zoneProgram", "Zone Floor Area": "zoneFloorArea", "Zone Volume": "zoneVolume", "Building Program": "bldgProgram", "Is Conditioned": "isConditioned", "Occupancy Schedule": "occupancySchedule", "Occupancy Activity Schedule": "occupancyActivitySch", "Heating SetPoint Schedule": "heatingSetPtSchedule", "Cooling SetPoint Schedule": "coolingSetPtSchedule"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}, selected="Natural Ventilation": "natVent")

textbox_4 = CreateTextBox(Label="Max Outdoor Temp for windows opening (C)", DefaultText="25", UpdateButton=True, showLabel=True)
values_10 = ValueListener(Elements=textbox_4, SomeProperty=True)  # -> Values, Indices

setepnatvent = Honeybee_SetEPAirFlow(
    HBZones=flatten(solveadjc.HBZonesWADJ),
    naturalVentilationType="1",
    minIndoorTempForNatVent=panel_8,
    maxOutdoorTempForNatVent=values_10.Values)  # -> readMe, simplify(HBZones); plug-in component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
labelzones = Honeybee_LabelZones(HBZones=flatten(setepnatvent.HBZones), attribute=zoneattributelist)  # -> zoneTxtLabels, labelBasePts, brepTxtLabels, zoneWireFrames; plug-in component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

panel_9 = Panel(setepnatvent.readMe)

panel_10 = Panel("https://energyplus.net/weather-download/europe_wmo_region_6/CHE//CHE_Geneva.067000_IWEC/all")
epoutput = Honeybee_GenerateEPOutput(zoneGainsAndLosses="False", zoneComfortMetrics="False", comfortMapVariables=Toggle(True), surfaceTempAnalysis="False")  # -> report, flatten(simulationOutputs); plug-in component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

textbox_5 = CreateTextBox(UrlFrom="url from EPW", DefaultText=panel_10, UpdateButton=True, showLabel=True)
merge_2 = Merge(
    Data1=textbox,
    Data2=slider,
    Data3=textbox_4,
    Data4=filepicker,
    Data5=datatable,
    Data6=textbox_2,
    Data7=textbox_5,
    Data8=true_button)
addelems_2 = AddElements(Window=launchwin, Elements=flatten(merge_2), DoVLChecking=True)  # -> AddedElements, ElementNames
values_11 = ValueListener(Elements=textbox_5, SomeProperty=True)  # -> Values, Indices

epw_stat = Ladybug_OpenEPWAndSTATWeatherFiles(weatherFileURL=values_11.Values)  # -> epwFile, statFile; plug-in component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

split_2 = SplitList(List=epoutput.simulationOutputs, Index=number_slider)  # -> ListA, ListB

# ----
# Run the Simulation
panel_11 = Panel("NatVentExample")
toggle = BooleanToggle(False)
exporttoopenstudio = Honeybee_ExportToOpenStudio(
    epwWeatherFile=epw_stat.epwFile,
    HBZones=flatten(setepnatvent.HBZones),
    simulationOutputs=flatten(split_2.ListA),
    writeOSM=values_7.Values,
    runSimulation=values_7.Values,
    fileName=panel_11)  # -> readMe, osmFileAddress, idfFileAddress, resultFileAddress, eioFileAddress, rddFileAddress, htmlReport, studyFolder, model; plug-in component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

panel_12 = Panel(split_2.ListA)
readepresult = Honeybee_ReadEPResult(resultFileAddress=exporttoopenstudio.resultFileAddress)  # -> port, port_2, port_3, port_4, port_5, port_6, port_7, port_8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; plug-in component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
split_3 = SplitList(List=readepresult.airFlowVolume, Index=Slider(7, range=0..10))  # -> ListA, ListB
panel_13 = Panel(readepresult.airFlowVolume)

# ---- group: m3/hr
multiplication_5 = Multiplication(A=split_3.ListB, B=3600)

# ----
branchdatadailymonthlyhourly_2 = Ladybug_BranchData(data=multiplication_5)  # -> dataEachDayOfYear, dataEachMonth, dataEachHourOfDay; plug-in component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
smaller = SmallerThan(FirstNumber=branchdatadailymonthlyhourly_2.dataEachMonth, SecondNumber=expression)  # -> SmallerThan, OrEqualTo
division_4 = Division(A=expression, B=branchdatadailymonthlyhourly_2.dataEachMonth)
mindex = MemberIndex(Set=smaller.SmallerThan, Member=Toggle(True))  # -> Index, flatten(Count)
panel_14 = Panel(mindex.Count)
graph = QuickGraph(mindex.Count)
writexl = WriteToExcel(
    Run=Toggle(True),
    ExcelWorksheet="1",
    ColumnNames=panel_7,
    WriteOptions="None",
    ColumnnsOrRows=True,
    DataToWriteIntoColumns=mindex.Count)
multichart = CreateMultiChart(Data=mindex.Count, Names=panel_7, Title="Monthly non-comfort hours", ClusterTitle="hours", ChartType=0)
merge_3 = Merge(Data1=multichart, Data2=image)
addelems_3 = AddElements(Window=launchwin_3, Elements=flatten(merge_3), DoVLChecking=True)  # -> AddedElements, ElementNames
_3dchart_2 = Ladybug_3DChart(inputData=flatten(division_4), xScale="0.25", legendPar=legendpar)  # -> readMe, graphMesh, graphCurves, legend, legendBasePts, title, titleBasePts, dataPts, conditionalHOY; plug-in component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
