# Grasshopper definition medial_axis.ghx (Grasshopper 1.0.7)

spacing = Slider(2.5, range=0..10)
crv = Curve(<curve referenced from the Rhino model>)
crv_2 = Curve(flatten(crv))
enabled = BooleanToggle(True)
list = ValueList({"No": 1, "Yes": 2}, selected="Yes")
c_script = CSharpScript(enable=enabled, singleItemCluster=list, cList=crv_2)  # -> out, Elapsed, curveClustersTree, connClustersTree; inputs enable: Boolean, singleItemCluster: Int32, cList: list of Curve
# ---------- c_script: C# ----------
    // by The Lord of Darkness due to critical Tequila starvation issues
    // BTW: I hate computers, .NET, .NOT, .WHATEVER, any Toyota and any Harley (yikes)

    // Accelerated by RadovanG

    if(!enable)return;

    cList = cList.Where(x => x != null).ToList();
    if(!cList.Any())return;

    System.Diagnostics.Stopwatch sw = new System.Diagnostics.Stopwatch();
    sw.Start();

    DataTree<Curve> curveClusters = new DataTree<Curve>();
    DataTree<int> connClusters = new DataTree<int>();
    MakeClusters(cList, ref curveClusters, ref  connClusters, singleItemCluster);
    sw.Stop();

    curveClustersTree = curveClusters;
    connClustersTree = connClusters;

    Print("Clusters made: {0}", curveClusters.BranchCount);
    Print("Clustered crvs: {0} out of: {1}", curveClusters.DataCount, cList.Count);

    Elapsed = (string.Format("Elapsed: {0}ms", sw.Elapsed.TotalMilliseconds));
# ---------- c_script: C# additional code ----------
  public void MakeClusters(List < Curve > cList, ref DataTree < Curve > curveClusters, ref DataTree < int > connClusters, int singleItemCluster){

    Plane plane = Plane.WorldXY;

    bool[] sampled = new bool[cList.Count];
    int branch = 0;
    double tol = RhinoDoc.ActiveDoc.ModelAbsoluteTolerance;

    var boundingBoxes = cList.Select((objR, index) => new { index, objR }).ToDictionary(x => x.index, y => y.objR.GetBoundingBox(true));
    RTree tree = new RTree();
    for (int i = 0; i < boundingBoxes.Count; i++) tree.Insert(boundingBoxes[i], i);

    DataTree<Curve> curveClustersLocal = new DataTree<Curve>();
    DataTree<int> connClustersLocal = new DataTree<int>();

    //// NEW -> START
    ILookup<int,int> ChildLookUp = FindeCurvesInsideCurves(cList);

    foreach (var grp in ChildLookUp)
    {
      if (grp.Key < 0) continue;
      int parent_id = grp.Key;
      Curve crvA = cList[parent_id];
      UpdateTrees(crvA, ref curveClustersLocal, ref connClustersLocal, ref sampled, parent_id, branch, true);
      foreach (var child_id in grp)
      {
        Curve crvB = cList[child_id];
        UpdateTrees(crvB, ref curveClustersLocal, ref connClustersLocal, ref sampled, child_id, branch, true);
      }
      branch++;
    }

    ////NEW -> END

    curveClusters = curveClustersLocal;
    connClusters = connClustersLocal;

    RebuildTree<Curve>(ref curveClusters);
    RebuildTree<int>(ref connClusters);

    if(singleItemCluster == 2 && cList.Count > curveClusters.DataCount){
      int bCount = curveClusters.BranchCount;
      for(int i = 0; i < sampled.Length;i++){
        bool bs = sampled[i];
        if(!bs) {
          curveClusters.Add(cList[i], new GH_Path(bCount));
          connClusters.Add(i, new GH_Path(bCount));
          bCount++;
        }
      }
    }
  }


  public void UpdateTrees(Curve crv, ref DataTree<Curve> curveClusters, ref DataTree<int> connClusters,
  ref bool[] sampled, int index, int branch, bool isSampled){
    curveClusters.Add(crv, new GH_Path(branch));
    connClusters.Add(index, new GH_Path(branch));
    sampled[index] = isSampled;
  }

  public void RebuildTree<T>(ref DataTree<T> tree){
    DataTree<T> tmp = new DataTree<T>();
    int count = 0;
    foreach(GH_Path path in tree.Paths){
      if(tree.Branch(path).Count > 0){
        tmp.AddRange(tree.Branch(path).ToList(), new GH_Path(count));
        count++;
      }
    }
    tree = tmp;
  }

  private static ILookup<int,int> FindeCurvesInsideCurves(List<Curve> cList)
  {
    #region data arrays/initialisation initialisation
    BoundingBox[] bbs = new BoundingBox[cList.Count];
    double[] minXs = new double[cList.Count];
    double[] minYs = new double[cList.Count];
    double[] maxXs = new double[cList.Count];
    double[] maxYs = new double[cList.Count];
    for (int i = 0; i < cList.Count; i++)
    {
      var bb = cList[i].GetBoundingBox(true);
      bbs[i] = bb;
      minXs[i] = bb.Min.X;
      minYs[i] = bb.Min.Y;
      maxXs[i] = bb.Max.X;
      maxYs[i] = bb.Max.Y;
    }
    var minXsOrderedIds = Enumerable.Range(0, cList.Count).ToArray();
    var minYsOrderedIds = Enumerable.Range(0, cList.Count).ToArray();
    var maxXsOrderedIds = Enumerable.Range(0, cList.Count).ToArray();
    var maxYsOrderedIds = Enumerable.Range(0, cList.Count).ToArray();

    Array.Sort(minXs, minXsOrderedIds);
    Array.Sort(minYs, minYsOrderedIds);
    Array.Sort(maxXs, maxXsOrderedIds);
    Array.Sort(maxYs, maxYsOrderedIds);

    int[] CurveID_PosIn_MinXsOrderedIds = new int[cList.Count];
    int[] CurveID_PosIn_MinYsOrderedIds = new int[cList.Count];
    int[] CurveID_PosIn_MaxXsOrderedIds = new int[cList.Count];
    int[] CurveID_PosIn_MaxYsOrderedIds = new int[cList.Count];

    List<int> Id_MinX_SmallestGT = new List<int>();
    int Id_MinX_SmallestGT_Start = 0;

    List<int> Id_MinY_SmallestGT = new List<int>();
    int Id_MinY_SmallestGT_Start = 0;

    List<int> Id_MaxX_LargestLT = new List<int>();
    int Id_MaxX_LargestLT_Last = -1;
    double MaxX_LargestLT_LastVal = maxXs[0];

    List<int> Id_MaxY_LargestLT = new List<int>();
    int Id_MaxY_LargestLT_Last = -1;
    double MaxY_LargestLT_LastVal = maxYs[0];
    #endregion

    #region fill smallest/largest Ids
    for (int i = 0; i < cList.Count; i++)
    {
      //CurveID_Position in ordered lists
      CurveID_PosIn_MinXsOrderedIds[minXsOrderedIds[i]] = i;
      CurveID_PosIn_MinYsOrderedIds[minYsOrderedIds[i]] = i;
      CurveID_PosIn_MaxXsOrderedIds[maxXsOrderedIds[i]] = i;
      CurveID_PosIn_MaxYsOrderedIds[maxYsOrderedIds[i]] = i;
      //
      if (minXs[i] > minXs[Id_MinX_SmallestGT_Start])
      {
        for (int j = Id_MinX_SmallestGT_Start; j < i; j++)
        {
          Id_MinX_SmallestGT.Add(i);
        }
        Id_MinX_SmallestGT_Start = i;
      }

      if (minYs[i] > minYs[Id_MinY_SmallestGT_Start])
      {
        for (int j = Id_MinY_SmallestGT_Start; j < i; j++)
        {
          Id_MinY_SmallestGT.Add(i);
        }
        Id_MinY_SmallestGT_Start = i;
      }

      if (maxXs[i] == MaxX_LargestLT_LastVal)
      {
        Id_MaxX_LargestLT.Add(Id_MaxX_LargestLT_Last);
      }
      else
      {
        Id_MaxX_LargestLT_Last = i - 1;
        MaxX_LargestLT_LastVal = maxXs[i];
        Id_MaxX_LargestLT.Add(Id_MaxX_LargestLT_Last);
      }

      if (maxYs[i] == MaxY_LargestLT_LastVal)
      {
        Id_MaxY_LargestLT.Add(Id_MaxY_LargestLT_Last);
      }
      else
      {
        Id_MaxY_LargestLT_Last = i - 1;
        MaxY_LargestLT_LastVal = maxYs[i];
        Id_MaxY_LargestLT.Add(Id_MaxY_LargestLT_Last);
      }
    }

    if (Id_MinX_SmallestGT.Count < cList.Count)
    {
      for (int i = Id_MinX_SmallestGT.Count; i < cList.Count; i++)
      {
        Id_MinX_SmallestGT.Add(-1);
      }
    }

    if (Id_MinY_SmallestGT.Count < cList.Count)
    {
      for (int i = Id_MinY_SmallestGT.Count; i < cList.Count; i++)
      {
        Id_MinY_SmallestGT.Add(-1);
      }
    }

    int[] Id_Largest_MinX_LT_MaxX = new int[cList.Count];
    var p_Counter = 0;

    int[] Id_Largest_MinY_LT_MaxY = new int[cList.Count];
    var r_Counter = 0;

    int[] Id_Smallest_MaxX_GT_MinX = new int[cList.Count];
    var s_Counter = 0;

    int[] Id_Smallest_MaxY_GT_MinY = new int[cList.Count];
    var t_Counter = 0;

    int k = 0;
    while (k < cList.Count)
    {
      while (p_Counter < cList.Count && minXs[p_Counter] < maxXs[k])
      {
        p_Counter++;
      }
      while (r_Counter < cList.Count && minYs[r_Counter] < maxYs[k])
      {
        r_Counter++;
      }
      while (s_Counter < cList.Count && maxXs[s_Counter] <= minXs[k])
      {
        s_Counter++;
      }
      while (t_Counter < cList.Count && maxYs[t_Counter] <= minYs[k])
      {
        t_Counter++;
      }
      Id_Largest_MinX_LT_MaxX[k] = p_Counter - 1;
      Id_Largest_MinY_LT_MaxY[k] = r_Counter - 1;
      Id_Smallest_MaxX_GT_MinX[k] = s_Counter;
      Id_Smallest_MaxY_GT_MinY[k] = t_Counter;
      k++;
    }
    #endregion

    int parent_id = -1;
    var parentId1 = Enumerable.Range(0, cList.Count).ToList().Select((a, i) => new { i, parent_id }).ToDictionary(a => a.i, a => a.parent_id);
    System.Collections.Concurrent.ConcurrentDictionary<int, int> parentId = new System.Collections.Concurrent.ConcurrentDictionary<int, int>(parentId1);
    int curveCount = cList.Count;

    System.Threading.Tasks.Parallel.For(0, cList.Count, i => {
      if (parentId[i] > -1)
      {
        return;
      }
      #region determine intervals in ordered arrays/lists of ids where curve belongs
      var Id_MinX_Low = Id_MinX_SmallestGT[CurveID_PosIn_MinXsOrderedIds[i]];
      var Id_MinX_High = Id_Largest_MinX_LT_MaxX[CurveID_PosIn_MaxXsOrderedIds[i]];
      if (Id_MinX_Low < 0) return;
      if (Id_MinX_High < Id_MinX_Low) return;
      int minLengthOfInterval = Id_MinX_High - Id_MinX_Low + 1;
      //
      int minInterval = 0;
      int id_high = Id_MinX_High;
      int id_low = Id_MinX_Low;
      var orderedIDs = minXsOrderedIds;

      var Id_MaxX_High = Id_MaxX_LargestLT[CurveID_PosIn_MaxXsOrderedIds[i]];
      var Id_MaxXs_Low = Id_Smallest_MaxX_GT_MinX[CurveID_PosIn_MinXsOrderedIds[i]];
      if (Id_MaxX_High < 0) return;
      if (Id_MaxX_High < Id_MaxXs_Low) return;
      if (minLengthOfInterval > Id_MaxX_High - Id_MaxXs_Low + 1)
      {
        minLengthOfInterval = Id_MaxX_High - Id_MaxXs_Low + 1;
        minInterval = 1;
      }

      var Id_MinY_Low = Id_MinY_SmallestGT[CurveID_PosIn_MinYsOrderedIds[i]];
      var Id_MinY_High = Id_Largest_MinY_LT_MaxY[CurveID_PosIn_MaxYsOrderedIds[i]];
      if (Id_MinY_Low < 0) return;
      if (Id_MinY_High < Id_MinY_Low) return;
      if (minLengthOfInterval > Id_MinY_High - Id_MinY_Low + 1)
      {
        minLengthOfInterval = Id_MinY_High - Id_MinY_Low + 1;
        minInterval = 2;
      }

      var Id_MaxY_High = Id_MaxY_LargestLT[CurveID_PosIn_MaxYsOrderedIds[i]];
      var Id_MaxY_Low = Id_Smallest_MaxY_GT_MinY[CurveID_PosIn_MinYsOrderedIds[i]];
      if (Id_MaxY_High < 0) return;
      if (Id_MaxY_High < Id_MaxY_Low) return;
      minLengthOfInterval = minLengthOfInterval < Id_MaxY_High - Id_MaxY_Low + 1 ? Id_MaxY_High - Id_MaxY_Low + 1 : minLengthOfInterval;
      if (minLengthOfInterval > Id_MaxY_High - Id_MaxY_Low + 1)
      {
        minLengthOfInterval = Id_MaxY_High - Id_MaxY_Low + 1;
        minInterval = 3;
      }

      switch (minInterval)
      {
        case 0:
          break;
        case 1:
          orderedIDs = maxXsOrderedIds;
          id_high = Id_MaxX_High;
          id_low = Id_MaxXs_Low;
          break;
        case 2:
          orderedIDs = minYsOrderedIds;
          id_high = Id_MinY_High;
          id_low = Id_MinY_Low;
          break;
        case 3:
          orderedIDs = maxYsOrderedIds;
          id_high = Id_MaxY_High;
          id_low = Id_MaxY_Low;
          break;
        default:
          break;
      }
      #endregion

      //here we cycle through all curve that has to be checked against i-curve
      for (int j = id_low; j <= id_high; j++)
      {
        var curveId = orderedIDs[j];
        if (parentId[curveId] > -1)
        {
          continue;
        }
        if (CurveID_PosIn_MinXsOrderedIds[curveId] >= Id_MinX_Low && CurveID_PosIn_MinXsOrderedIds[curveId] <= Id_MinX_High &&
          CurveID_PosIn_MaxXsOrderedIds[curveId] >= Id_MaxXs_Low && CurveID_PosIn_MaxXsOrderedIds[curveId] <= Id_MaxX_High &&
          CurveID_PosIn_MinYsOrderedIds[curveId] >= Id_MinY_Low && CurveID_PosIn_MinYsOrderedIds[curveId] <= Id_MinY_High &&
          CurveID_PosIn_MaxYsOrderedIds[curveId] >= Id_MaxY_Low && CurveID_PosIn_MaxYsOrderedIds[curveId] <= Id_MaxY_High)
        {
          Curve crvB = cList[curveId];
          Point3d ptStart = crvB.PointAtStart;
          var pointContainment = cList[i].Contains(ptStart);
          if (pointContainment == PointContainment.Inside)
          {
            parentId[curveId] = i;
            //parentId[i] = i;
          }
        }
      }
      });
    ILookup<int,int> lookup = parentId.ToLookup(d => d.Value, d => d.Key);
    return lookup;
  }
# ---------- end c_script ----------
divide = DivideCurve(Curve=c_script.curveClustersTree, Count=Slider(500, range=0..1000), Kinks=False)  # -> simplify(Points), Tangents, Parameters
path_mapper = PathMapper(divide.Points, source=["{A}", "{A;B}"], target=["{A}", "{A}"])
voronoi = Voronoi(Points=path_mapper, BruteForceOverride=False)  # -> simplify(Cells)
unflatten = UnflattenTree(Tree=voronoi, Guide=divide.Points)
graft = GraftTree(Tree=c_script.curveClustersTree, IncludeEmptyLists=True, IncludeNullItems=True)  # -> simplify(Tree)
trim = TrimWithRegion(Curve=unflatten, Region=graft)  # -> Inside, Outside
path_mapper_2 = PathMapper(trim.Outside, source=["{A;B}", "{A;B;C}"], target=["{A}", "{A;B}"])
path_mapper_3 = PathMapper(trim.Inside, source=["{A;B}", "{A;B;C}"], target=["{A}", "{A;B}"])
split = SplitTree(Data=path_mapper_2, Masks=flatten("{?;!0}"))  # -> Positive, Negative
split_2 = SplitTree(Data=path_mapper_3, Masks=flatten("{?;0}"))  # -> Positive, Negative
item = ListItem(List=flatten(split_2.Positive), Index=0, Wrap=True)
null = NullItem(Item=item)  # -> NullFlags, InvalidFlags, Description
filter = StreamFilter(Gate=null.NullFlags, Stream0=split_2.Positive, Stream1=split_2.Negative)
merge = Merge(Data1=filter, Data2=split.Positive)
path_mapper_4 = PathMapper(merge, source=["{A}", "{A;B}"], target=["{A}", "{A}"])
explode = Explode(Curve=path_mapper_4, Recursive=True)  # -> simplify(Segments), Vertices
colom = CollisionOneMany(Collider=explode.Segments, Obstacles=flatten(crv_2))  # -> Collision, Index
not = GateNot(A=colom.Collision)
cull = CullPattern(List=explode.Segments, CullPattern=not)

# ---- group: check tree depth
tree_statistics = TreeStatistics(Tree=cull)  # -> Paths, Length, Count
deconstruct_path = DeconstructPath(Branch=tree_statistics.Paths)
list_length = ListLength(List=deconstruct_path)  # -> flatten(Length)
create_set = CreateSet(List=list_length)  # -> Set, Map
subtraction = Subtraction(A=create_set.Set, B=1)
boolean = Boolean(subtraction)

# ----
stream_gate = StreamGate(Stream=cull, Gate=boolean)  # -> Target0, Target1

# ---- group: voronoi curves not touching boundary curve
trim_2 = TrimTree(Tree=stream_gate.Target1, Depth=boolean)

# ----
eval = EvaluateCurve(Curve=reparameterize(trim_2), Parameter=Slider(0.5, range=0..1))  # -> Point, Tangent, Angle
cullpt = CullDuplicates(Points=eval.Point, Tolerance=Slider(0.1, range=0..1), CullMode=3)  # -> simplify(Points), simplify(Indices), simplify(Valence)
fsim = FindSimilarMember(Data=cullpt.Points, Set=eval.Point)  # -> Hit, Index
panel = Panel(fsim.Index)

# ---- group: culled lines
cull_i = CullIndex(List=trim_2, Indices=fsim.Index, Wrap=True)  # -> simplify(List)

# ----
join = JoinCurves(Curves=cull_i, Preserve=False)  # -> simplify(Curves)

# ---- group: medial axes
redpline = Reduce(Polyline=join, Tolerance=Slider(0.2, range=0..1))  # -> Polyline, Reduction

# ----
divlength = DivideLength(Curve=[stream_gate.Target0, redpline.Polyline], Length=spacing)  # -> Points, Tangents, Parameters
trim_3 = TrimTree(Tree=divlength.Points, Depth=1)
cullpt_2 = CullDuplicates(Points=trim_3, Tolerance=Slider(1, range=0..1), CullMode=3)  # -> simplify(Points), Indices, Valence
panel_2 = Panel("""geometry
medial axis
topology""")
P = Points(cullpt_2.Points)
exporthydra = Hydra_ExportFile(
    fileName="medial_axis",
    fileDescription="get the medial axis of input curves via grasshopper",
    fileTags=panel_2,
    includeRhino=Toggle(True),
    GHForThumb=Toggle(True),
    export=Toggle(False))  # -> out; inputs fileDescription: list, changeLog: list, fileTags: list, includeRhino: Boolean, GHForThumb: Boolean, additionalImgs: list, export: Boolean
# ---------- exporthydra: Python ----------
# Hydra: A Plugin for example file sharing
# 
# This file is part of Hydra.


"""
Use this component to export your GH file to your Hydra repository so that you can upload and share with the community!
-
Provided by Hydra 0.0.02

    Args:
        _fileName: A text name for your example file.
        _fileDescription: A text description of your example file.  This can be a list and each item will be written as a new paragraph.
        changeLog_: A text description of the changes that you have made to the file if this is a new version of an old example file.
        fileTags_: An optional list of test tags to decribe your example file.  This will help others search for your file easily.
        targetFolder_: Input a file path here to the hydra folder on you machine if you are not using the default Github structure that places your hydra github repo in your documents folder.
        includeRhino_: Set to 'True' to include the Rhino file in the zip file that gets uploaded to your hydra fork.  This is important if you are referencing Rhino geometry and have not internalized it in the GH document.  By default, this is set to 'False', which will only include the grasshopper file.
        GHForThumb_: Set to 'True' to have the thumbnail of your example file be of your GH canvas.  By default, the thumbnail will be of the Rhino scene since this is where the cool geometric output of the file displays.  If your file is not producing a geometric output, you will want to set this to 'True.'
        additionalImgs_: A list of file paths to additional images that you want to be shown in Hydra page 
        _export: Set to "True" to export the Grasshopper file to Hydra.
    Returns:
        readMe!: ...
"""

ghenv.Component.Name = "Hydra_ExportFile"
ghenv.Component.NickName = 'exportHydra'
ghenv.Component.Message = 'VER 0.0.02\nNOV_18_2015'
ghenv.Component.Category = "Extra"
ghenv.Component.SubCategory = "Hydra"
try: ghenv.Component.AdditionalHelpFromDocStrings = "1"
except: pass

import Grasshopper.Kernel as gh
import scriptcontext as sc
import shutil
import os
import zipfile
import Grasshopper.GUI as ghGUI
import System
import Grasshopper.Instances as ghInst
import time
from time import mktime
from datetime import datetime
import json
import Rhino as rc


def checkTheInputs():
    # Set a warning variable.
    w = gh.GH_RuntimeMessageLevel.Warning
    c = gh.GH_RuntimeMessageLevel.Remark
    
    #Replace any spaces in the connected fileName with underscores.
    fileName = _fileName.strip().replace(" ","_")
    
    #Set a default directory to the Github default if none has been input.
    checkData1 = True
    repoTargetFolder = None
    fullForkTarget = None
    if targetFolder_:
        if not os.path.isdir(targetFolder_):
            checkData1 = False
            warning = "The connected directory to targetFolder_ does not exist on your machine."
            print warning
            ghenv.Component.AddRuntimeMessage(w, warning)
        else:
            if targetFolder_.endswith('\\'):
                repoTargetFolder = targetFolder_ + fileName
                fullForkTarget = targetFolder_
            else:
                repoTargetFolder = targetFolder_ + '\\' + fileName
                fullForkTarget = targetFolder_ + '\\'
    else:
        hydraFolder = None
        username = os.getenv("USERNAME")
        githubDirectory = "E:\\GitHub\\"
        for file in os.listdir(githubDirectory):
            if 'hydra' in file: hydraFolder = githubDirectory + file + "\\"
        if hydraFolder == None: hydraFolder = "C:\\Users\\" + username + "\\Documents\\GitHub\\hydra\\"
        if not os.path.isdir(hydraFolder):
            checkData1 = False
            warning = "The component cannot automatically find the hydra repo on your machine. \n Plug in the correct file path of the hydra repo to the targetFolder_ input on this component."
            print warning
            ghenv.Component.AddRuntimeMessage(w, warning)
        else:
            repoTargetFolder = hydraFolder + fileName
            fullForkTarget = hydraFolder
    
    
    # Check the directory and create it if it does not exist.  If it does exist, it is, there is not an old version of this example file and I should make a new directory.
    gitUserTrigger = False
    gitUserName = None
    forkName = None
    checkData2 = True
    if repoTargetFolder != None:
        
        #Pull out the username from the config file.
        configFile = fullForkTarget + '.git\\config'
        if os.path.isfile(configFile):
            with open(configFile, "r") as cnfFile:
                for lineCount, line in enumerate(cnfFile):
                    if '[remote "origin"]' in line: gitUserTrigger = True
                    elif gitUserTrigger == True and 'https://github.com/' in line:
                        gitUserName = line.split('https://github.com/')[-1].split('/')[0]
                        forkName = line.split('/')[-1].split('.git')[0]
                        gitUserTrigger = False
        else:
            checkData2 = False
            warning = "Could not find the config file in your Hydra fork on your system. \n Make sure that you have cloned hydra to your system. \n If you have cloned hydra, plug in the correct file path of the hydra repo to the targetFolder_ input on this component."
            print warning
            ghenv.Component.AddRuntimeMessage(w, warning)
    
    #Make a list of file tags that includes the example file name if nothing else is connected.
    if len(fileTags_) == 0:
        fileTags = []
        for word in _fileName.split(' '):
            fileTags.append(word)
    elif len(fileTags_) == 1 and ',' in fileTags_[0]:
        fileTags = fileTags_[0].split(',')
    elif len(fileTags_) == 1 and ';' in fileTags_[0]:
        fileTags = fileTags_[0].split(';')
    elif len(fileTags_) == 1:
        fileTags = fileTags_[0].split('\n')
    else:
        fileTags = fileTags_
    
    if not 'Grasshopper' in fileTags and \
       not 'grasshopper' in fileTags:
        fileTags.append('Grasshopper')
    
    fileTags = [tag.strip() for tag in fileTags]
    
    #Check to be sure that the user has saved this currently open GH file so that we can copy it.
    checkData3 = True
    document = ghenv.Component.OnPingDocument()
    doucumentPath = document.FilePath
    if doucumentPath!=None and os.path.isfile(doucumentPath): pass
    else:
        checkData3 = False
        warning = "You have not yet saved this Grasshopper file to your machine. \n You must save it first in order to export it to Hydra."
        print warning
        ghenv.Component.AddRuntimeMessage(w, warning)
    
    #Check to be sure that the user has saved this currently open Rhino file so that we can copy it.
    checkData4 = True
    rhinoDocPath = rc.RhinoDoc.ActiveDoc.Path
    if os.path.isfile(rhinoDocPath): pass
    elif not os.path.isfile(rhinoDocPath) and includeRhino_ == True:
        checkData4 = False
        warning = "You must save your Rhino file in order to export it to Hydra. \nEither save your file or set 'includeRhino_' to 'False'."
        print warning
        ghenv.Component.AddRuntimeMessage(w, warning)
    else:
        comment = "You have not yet saved this Rhino file to your machine. \nYou will be able to use the 'includeRhino_' input to this component to include the rhino file with your example."
        print comment
        ghenv.Component.AddRuntimeMessage(c, comment)
    
    #Give a final check for everything.
    if checkData1 == True and checkData2 == True and checkData3 == True and checkData4 == True: checkData = True
    else: checkData = False
    
    
    return checkData, fileName, _fileDescription, fileTags, repoTargetFolder, doucumentPath, document, rhinoDocPath, gitUserName, forkName


def writeGHRhino(fileName, repoTargetFolder, doucumentPath, rhinoDocPath):
    #Write out a list for the source files.
    zipFileDirectory = repoTargetFolder + '\\' + fileName
    if not os.path.isdir(zipFileDirectory): os.mkdir(zipFileDirectory)
    
    #Write out a GH file to the folder.
    ghFilePath = zipFileDirectory + '\\' + fileName + '.gh'
    shutil.copyfile(doucumentPath, ghFilePath)
    
    #If the user has requested writing the Rhino file, write it there.
    rhinoWritten = False
    rhioDestinationPath = zipFileDirectory + '\\' + fileName + '.3dm'
    if includeRhino_:
        if rhinoDocPath != '':
            shutil.copyfile(rhinoDocPath, rhioDestinationPath)
            rhinoWritten = True
    else:
        rhioDestinationPath = zipFileDirectory + '\\' + fileName + '.3dm'
        if os.path.isfile(rhioDestinationPath):
            os.remove(rhioDestinationPath)
    
    #Zip the files together.
    zipFilePath = repoTargetFolder + '\\' + fileName
    
    zf = zipfile.ZipFile("%s.zip" % (zipFilePath), "w", zipfile.ZIP_DEFLATED)
    abs_src = os.path.abspath(zipFileDirectory)
    for dirname, subdirs, files in os.walk(zipFileDirectory):
        for filename in files:
            absname = os.path.abspath(os.path.join(dirname, filename))
            arcname = absname[len(abs_src) + 1:]
            zf.write(absname, arcname)
    zf.close()
    
    #Delete the old zip directory.
    shutil.rmtree(zipFileDirectory)
    
    return zipFilePath


def writeReadMe(fileName, fileDescription, repoTargetFolder, changeLog, gitUserName, fileTags, forkName):
    readMeFilePath = repoTargetFolder + '\\' + 'README.md'
    
    #Write the description.
    readMeFile = open(readMeFilePath, "w")
    readMeFile.write('### Description \n')
    for line in fileDescription:
        readMeFile.write(line + '\n')
    readMeFile.write('\n')
    
    #Write in a link to the user's page and to the hydra page.
    readMeFile.write('This file has been submitted by [' + gitUserName + '](https://github.com/' + gitUserName + ')')
    readMeFile.write('\n')
    readMeFile.write('\n')
    readMeFile.write('[Check out this example on Hydra!](http://hydrashare.github.io/hydra/viewer?owner=' + gitUserName + '&fork=' + forkName + '&id=' + fileName + ')')
    readMeFile.write('\n')
    
    # Write change log in the file
    if len(changeLog) != 0:
        for line in changeLog:
            readMeFile.write(line + '\n')
    
    #Write in the file tags.
    readMeFile.write('### Tags \n')
    for linecount, line in enumerate(fileTags):
        if linecount+1 != len(fileTags): readMeFile.write(line + ', ')
        else: readMeFile.write(line)
    readMeFile.write('\n')
    
    #Write in a link to the thumbnail.
    readMeFile.write('### Thumbnail \n')
    readMeFile.write("![Screenshot](https://raw.githubusercontent.com/" + gitUserName + "/hydra/master/" + fileName + "/thumbnail.png)")
    readMeFile.write('\n')
    
    readMeFile.close()
    
    return readMeFilePath



def getAllTheComponents(document, onlyGHPython = False):
    components = []
    
    for component in document.Objects:
        if onlyGHPython and type(component)!= type(ghenv.Component): pass
        else: components.append(component)
    
    return components


def getMetaData(ghComps, fileTags, fileName, rhinoDocPath, additionalImgs):
    #Create the dictionary.
    metaDataDict = {}
    
    #Get the names of all of the components on the canvas and add them to the dictionary.
    metaDataDict["components"] = {}
    metaDataDict["images"] = []
    metaDataDict["videos"] = {}
    metaDataDict["dependencies"] = []
    
    grasshopperNative = ['Params', 'Maths', 'Sets', 'Vector', 'Curve', 'Surface', 'Mesh', 'Intersect', 'Transform', 'Display', 'Hydra']
    notImportantComps = ['Hydra', 'Scribble', 'Hydra_ExportFile', 'Hydra_ImportFile', 'Group', 'Panel', 'Slider', 'Boolean Toggle', 'Custom Preview', 'Colour Swatch','Button', 'Control Knob', 'Digit Scroller', 'MD Slider', 'Value List', 'Point', 'Vector', 'Circle', 'Circular Arc', 'Curve', 'Line', 'Plane', 'Rectangle', 'Box', 'Mesh', 'Mesh Face', 'Surface', 'Twisted Box', 'Field', 'Geometry', 'Geometry Cache', 'Geometry Pipeline', 'Transform']
    
    for component in ghComps:
        componentName = component.Name
        if componentName in notImportantComps: pass
        elif metaDataDict["components"].has_key(componentName):
            metaDataDict["components"][componentName] += 1
        else:
            metaDataDict["components"][componentName] = 1
        
        # find dependencies
        componentCategory = component.Category
        if componentCategory == "Extra" or componentCategory == "User":
                componentCategory = component.SubCategory
                
        if componentCategory not in grasshopperNative + metaDataDict["dependencies"]:
            metaDataDict["dependencies"].append(componentCategory)
            
    #Put in tags.
    metaDataDict['tags'] = fileTags
    
    # Put in the path to the gh scene image.
    metaDataDict["images"].append({fileName + '_GH.png' : "Grasshopper Definition"})
    
    # Put in the path to the rhino scene image.
    if not GHForThumb_:
        metaDataDict["images"].append({fileName + '_Rhino.png' : "Rhino Viewport Screenshot"})
    
    # add additional images to image list; at some point we should expose adding description for each image
    for img in additionalImgs:
        if os.path.isfile(img):
            metaDataDict["images"].append({os.path.split(img)[1] : "Additional Image"})
    
    # Put in the path to the thumbnail file.
    metaDataDict['thumbnail'] = 'thumbnail.png'
    
    # Put in the path to the zip file.
    metaDataDict['file'] = fileName + '.zip'
    
    
    return metaDataDict


def writeMetadataFile(fileName, repoTargetFolder, metaDataDict):
    jsonFilePath = repoTargetFolder + '\\' + 'input.json'
    with open(jsonFilePath, "w") as outfile:
        json.dump(metaDataDict, outfile)
    
    return jsonFilePath


def writeGHImage(fileName, repoTargetFolder):
    #Set the final File Path.
    filePathName = repoTargetFolder + '\\' + fileName + '_GH.png'
    
    #Take a tiled image using the GH Method.
    imageSettings = ghGUI.Canvas.GH_Canvas.GH_ImageSettings()
    canvas = ghInst.ActiveCanvas
    rect = gh.GH_Convert.ToRectangle(canvas.Document.BoundingBox(False))
    
    #System.Drawing.Rectangle 
    imgsOfCanvas = ghGUI.Canvas.GH_Canvas.GenerateHiResImage(canvas, rect, imageSettings)
    
    #This part is adapted and translated from David Rutten's VB script:
    # http://www.grasshopper3d.com/forum/topics/access-to-grasshopper-image-stitcher-ghis
    #Long live David!!!!
    
    #Prepare a large image to absorb the smaller images.
    tileWidth = 1000
    tileHeight = 1000
    width = int(str(imgsOfCanvas[-1]).split(',')[0].split('=')[-1])
    height = int(str(imgsOfCanvas[-1]).split(',')[-1].split('=')[-1].split('}')[0])
    smallImages = imgsOfCanvas[0]
    
    #If the image is too large, rezie it.
    if width > 16000 : width = 16000
    if height > 16000: height = 16000
    
    #Build the big image.
    fullImage = System.Drawing.Bitmap(width, height, System.Drawing.Imaging.PixelFormat.Format24bppRgb)
    fullFrame = System.Drawing.Rectangle(0, 0, tileWidth, tileHeight)
    fullGraphics = System.Drawing.Graphics.FromImage(fullImage)
    fullGraphics.InterpolationMode = System.Drawing.Drawing2D.InterpolationMode.NearestNeighbor
    fullGraphics.Clear(System.Drawing.Color.White)
    
    #Re-order the list of images to be correct
    newSmallImgDict = {}
    for image in smallImages:
        imageEnd = str(image).split('\\')[-1].split('.png')[0]
        imageHoriz = imageEnd.split(';')[0]
        imageVert = imageEnd.split(';')[-1]
        if not newSmallImgDict.has_key(imageHoriz) and int(imageHoriz) <= 15 and int(imageVert) <= 15: newSmallImgDict[imageHoriz] = [image]
        elif int(imageHoriz) <= 15 and int(imageVert) <= 15: newSmallImgDict[imageHoriz].append(image)
    
    #Join the smaller images into the larger images.
    fullFrame.Y = 0
    for columnNum in range(len(newSmallImgDict)):
        for rowNum in range(len(newSmallImgDict['0'])):
            #Select out the correct image.
            image = newSmallImgDict[str(columnNum)][rowNum]
            
            #Adjust the frame.
            #We need to move it right by tileWidth pixel
            #If the frame goes past the right, move it to the top of the next column.
            if fullFrame.Y >= height:
                fullFrame.Y = 0
                fullFrame.X += tileWidth
            
            #Now load the target image from the disk...
            targetImage = System.Drawing.Bitmap(image)
            
            #...and paint it into the target frame
            fullGraphics.DrawImage(targetImage, fullFrame)
            
            #Delete the targetImage from memory.
            targetImage.Dispose()
            
            fullFrame.Y += tileHeight
    
    
    #Save the image and dispose of it from memory.
    fullImage.Save(filePathName)
    fullGraphics.Dispose()
    
    return filePathName, fullImage, width, height


def writeRhinoImage(fileName, repoTargetFolder):
    viewtoCapture = sc.doc.Views.ActiveView  
    dispMode = viewtoCapture.ActiveViewport.DisplayMode
    image_h = viewtoCapture.ActiveViewport.Size.Height
    image_w = viewtoCapture.ActiveViewport.Size.Width
    viewSize = System.Drawing.Size(int(image_w), int(image_h))
    pic = rc.Display.RhinoView.CaptureToBitmap(viewtoCapture , viewSize)
    
    fullPath = repoTargetFolder + '\\' + fileName + '_Rhino.png'
    System.Drawing.Bitmap.Save(pic , fullPath)
    
    return fullPath, pic, image_w, image_h

def copyAddiationalImages(additionalImgs, repoTargetFolder):
    
    for img in additionalImgs:
        #chek if the file already exist
        if os.path.isfile(img):
            # copy to the file to the folder
            try:
                shutil.copyfile(img, repoTargetFolder + '\\' + os.path.split(img)[1])
            except:
               msg = "Failed to copy " + img
               print msg

def makeThumbnailImg(ghImgFile, rhinoImgFile, gw, gh, rw, rh, repoTargetFolder):
    #Set universal variables.
    thumbnailPath = repoTargetFolder + '\\' + 'thumbnail.png'
    thumbnailW = 200
    
    if GHForThumb_:
        #Calculate what the height should be.
        imgRatio = gh/gw
        thumbnailH = thumbnailW*imgRatio
        imgSize = System.Drawing.Size(thumbnailW, thumbnailH)
        imgHeight = ghImgFile.Height
        #Get the thumbnail image and save it
        fullImage = System.Drawing.Bitmap(ghImgFile,imgSize)
        System.Drawing.Bitmap.Save(fullImage , thumbnailPath)
    else:
        #Calculate what the height should be.
        imgRatio = rh/rw
        thumbnailH = thumbnailW*imgRatio
        imgSize = System.Drawing.Size(thumbnailW, thumbnailH)
        #Get the thumbnail image and save it
        fullImage = System.Drawing.Bitmap(rhinoImgFile,imgSize)
        System.Drawing.Bitmap.Save(fullImage , thumbnailPath)
    
    
    return thumbnailPath, fullImage


def main(fileName, fileDescription, fileTags, repoTargetFolder, doucumentPath, \
        document, rhinoDocPath, gitUserName, forkName, additionalImgs):
    #Write the GH file into a GHX file.
    ghFile = writeGHRhino(fileName, repoTargetFolder, doucumentPath, rhinoDocPath)
    
    #Take a high-res image of the grasshopper canvass.
    ghImgFile, ghImg, gw, gh = writeGHImage(fileName, repoTargetFolder)
    
    #Take an image of the Rhino scene
    if not GHForThumb_:
        rhinoImgFile, rhImg, rw, rh = writeRhinoImage(fileName, repoTargetFolder)
    else:
        rhImg, rw, rh = "", 1, 1
        
    #Make a thumbnail image.
    thumbnailImgFile, thumbnailImg = makeThumbnailImg(ghImg, rhImg, gw, gh, rw, rh, repoTargetFolder)
    
    #Clear the images from the computer memory.
    ghImg.Dispose()
    if not GHForThumb_:
        rhImg.Dispose()
    thumbnailImg.Dispose()    
    
    #Copy additional images to folder if any
    copyAddiationalImages(additionalImgs, repoTargetFolder)
    
    #Write the readMe into a text file.
    descriptFile = writeReadMe(fileName, fileDescription, repoTargetFolder, changeLog_, gitUserName, fileTags, forkName)
    
    #Get all of the components on the canvass and pull out their information so that they can be written into a metadata file.
    ghComps = getAllTheComponents(document)
    metaDataDict = getMetaData(ghComps, fileTags, fileName, rhinoDocPath, additionalImgs)
    metadataFile = writeMetadataFile(fileName, repoTargetFolder, metaDataDict)



if _export:
    if _fileName and len(_fileDescription) != 0:
        checkData, fileName, fileDescription, fileTags, repoTargetFolder, \
            doucumentPath, document, rhinoDocPath, gitUserName, forkName = checkTheInputs()
        
        if checkData == True:
            main(fileName, fileDescription, fileTags, repoTargetFolder, \
                doucumentPath, document, rhinoDocPath, gitUserName, \
                forkName, additionalImgs_)
    else:
        msg = "One of the mandatory inputs is missing!"
        print msg
        ghenv.Component.AddRuntimeMessage(gh.GH_RuntimeMessageLevel.Warning, msg)
# ---------- end exporthydra ----------
